# Dynamo graph findrulinglinessimple.dyn (Dynamo 0.7.5.3566)

addItemToEnd = List.AddItemToEnd()
code_block = CodeBlock { Point.ByCoordinates(0,10,1); Point.ByCoordinates(5,5,0); Point.ByCoordinates(2,4,0); }
byThreePoints = Arc.ByThreePoints(code_block.out0, code_block.out1, code_block.out2)
code_block_2 = CodeBlock { Point.ByCoordinates(0,10,3); Point.ByCoordinates(5,5,3); Point.ByCoordinates(2,4,3); }
byThreePoints_2 = Arc.ByThreePoints(code_block_2.out0, code_block_2.out1, code_block_2.out2)
create = List.Create(byThreePoints, byThreePoints_2)
byLoft = Surface.ByLoft(create)
code_block_3 = CodeBlock { 0.1; }
findRulingLines = DynamoUnfold.Unfolding.findRulingLines(byLoft, code_block_3)
code_block_4 = CodeBlock { 0.5; }
pointAtParameter = Curve.PointAtParameter(findRulingLines, code_block_4)
normalAtPoint = Surface.NormalAtPoint(byLoft, pointAtParameter)
add = Point.Add(pointAtParameter, normalAtPoint)
create_2 = List.Create()
code_block_5 = CodeBlock { 0..1..1; }
flatten = Flatten(findRulingLines)
pointAtParameter_2 = Curve.PointAtParameter(flatten)
map = List.Map(code_block_5, pointAtParameter_2)
code_block_6 = CodeBlock(a=map) { a[0]; a[1]; }
combine = List.Combine(create_2, code_block_6.out0, code_block_6.out1)
combine_2 = List.Combine(addItemToEnd, add, combine)
code_block_7 = CodeBlock { 1; }
flatten_2 = List.Flatten(combine_2, code_block_7)
byBestFitThroughPoints = Plane.ByBestFitThroughPoints(flatten_2)
intersect = Geometry.Intersect(byBestFitThroughPoints, byLoft)
